# Grasshopper definition cross.gh (Grasshopper 1.0.7)
# plug-ins: compas_wood, ghgl, NGon

number_slider = Slider(2, range=0..10)  # disabled
mesh = Mesh(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)  # disabled
panel = Panel("0")  # disabled
number_slider_2 = Slider(4, range=0..10)  # disabled
number_slider_3 = Slider(15, range=0..170)  # disabled
crv = Curve([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])  # disabled
number_slider_4 = Slider(-1, range=-10..10)  # disabled
number_slider_5 = Slider(-12, range=-20..10)  # disabled
rect_thickness = Slider(1, range=0..10)  # disabled
brep = Brep([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])  # disabled
c_script = CSharpScript(
    m=mesh,
    face_positions=panel,
    face_thickness=number_slider_2,
    divisions=number_slider,
    division_len=number_slider_3,
    edge_vectors=crv,
    rect_width=number_slider_4,
    rect_height=number_slider_5,
    rect_thickness=rect_thickness,
    projection=brep,
    Reference="C:\Users\petra\AppData\Roaming\Grasshopper\Libraries\compas_wood\rhino_util.dll")  # -> out, f, f_pl, f_id, e, e_pl, e_id; inputs m: Mesh, face_positions: list of Double, face_thickness: Double, divisions: list of Int32, division_len: list of Double, edge_vectors: list of Line, rect_width: Double, rect_height: Double, rect_thickness: Double, projection: list of Brep; disabled
# ---------- c_script: C# usings ----------
using rhino_util;
using System.Linq;
# ---------- c_script: C# ----------
    try{
      vda vda = new vda(
        m, null,
        face_thickness, face_positions,
        divisions, division_len,
        edge_vectors, rect_width, rect_height, rect_thickness, projection);

      //A = rhino_util.GrasshopperUtil.IE2(vda.fe_planes);
      //C = vda.f_planes;

      //E = vda.e90_planes;
      //F = rhino_util.GrasshopperUtil.IE2(vda.e90_multiple_planes);
      //G = rhino_util.GrasshopperUtil.IE2(vda.e_polylines);
      //E = vda.e90_planes;_


      f = rhino_util.GrasshopperUtil.IE2(vda.f_polylines);
      f_pl = rhino_util.GrasshopperUtil.IE2(vda.f_polylines_planes);
      f_id = rhino_util.GrasshopperUtil.IE2(vda.f_polylines_index);
      e = rhino_util.GrasshopperUtil.IE2(vda.e_polylines);
      e_pl = rhino_util.GrasshopperUtil.IE2(vda.e_polylines_planes);
      e_id = rhino_util.GrasshopperUtil.IE2(vda.e_polylines_index);

    }catch(Exception ee){
      Print(ee.ToString());
    }
# ---------- c_script: C# additional code ----------
  public class vda{

    //input
    public Mesh m = null;
    public Surface s = null;
    public double face_thickness = 1;
    public List<double> face_positions = new List<double>();
    public List<Brep> projection_breps = new List<Brep>();
    public List<int> edge_divisions = new List<int>();
    public List<double> edge_division_len = new List<double>();
    public Vector3d[] insertion_vectors = new Vector3d[0];

    //indices
    bool has_ngons = false;
    public int f;
    public int e;
    public int[][] f_v;
    public int[][] f_e;
    public int[][] e_f;
    public Dictionary<int,int> e_ngon_e;
    double rect_width = 1;
    double rect_height = 1;
    double rect_thickness = 1;
    //planes
    public Plane[] f_planes = new Plane[0];
    public Plane[][] fe_planes = new Plane[0][];
    public Plane[][] bi_planes = new Plane[0][];
    public Plane[] e90_planes = new Plane[0];
    public Plane[][] e90_multiple_planes = new Plane[0][];
    public Line[] e_lines = new Line[0];

    //output
    //polylines
    public string[][] f_polylines_index = new string[0][];
    public Plane[][] f_polylines_planes = new Plane[0][];
    public Polyline[][] f_polylines = new Polyline[0][];


    public string[][] e_polylines_index = new string[0][];
    public Plane[][] e_polylines_planes = new Plane[0][];
    public Polyline[][] e_polylines = new Polyline[0][];






    //Division per edge
    //Number of layers
    //Length of joint
    //Rotate or insertion direction per each edge

    public vda(Mesh m, Surface s,
      double face_thickness, List<double> face_positions, List<int> edge_divisions,
      List<double> edge_division_len, List<Line> insertion_vectors,
    double rect_width, double rect_height, double rect_thickness, List<Brep> projection_breps){
      if(m == null) return;
      if(!m.IsValid) return;
      m.Weld(0.01);
      m.RebuildNormals();
      this.m = m.DuplicateMesh();
      this.s = s;
      this.face_thickness = face_thickness;
      this.face_positions = face_positions;
      this.face_positions.Sort();

      if(this.face_positions.Count == 0)
        this.face_positions = new List<double>{0};


      this.projection_breps = projection_breps;
      this.edge_divisions = edge_divisions;
      this.edge_division_len = edge_division_len;
      this.edge_division_len = edge_division_len;
      this.has_ngons = m.Ngons.Count > 0;
      this.rect_width = rect_width;
      this.rect_height = rect_height;
      this.rect_thickness = rect_thickness;
      //run methods in constructor
      get_face_vertices();
      get_faces_planes();
      get_face_edge_planes();
      get_bisector_planes();
      get_face_polylines();
      get_edges();
      get_edge_faces();
      get_edge_vectors(insertion_vectors);
      get_edge_planes();
      get_connectors();
    }

    //Compute mesh properties

    public void get_face_vertices(){
      if(has_ngons){
        this.f = this.m.Ngons.Count;
        f_v = m.GetNGonsTopoBoundaries();
      }else
      {
        this.f = this.m.Faces.Count;
        f_v = new int[this.m.Faces.Count][];
        for(int i = 0; i < this.m.Faces.Count;i++ )

          f_v[i] = this.m.Faces[i].IsQuad ? new int[] { this.m.Faces[i][0], this.m.Faces[i][1], this.m.Faces[i][2], this.m.Faces[i][3] } : new int[] { this.m.Faces[i][0], this.m.Faces[i][1], this.m.Faces[i][2] };
      }
    }

    public void get_faces_planes(){

      if(has_ngons){
        f_planes = m._FPlanes();
      }else{
        f_planes = new Plane[m.Faces.Count];
        for(int i = 0; i < m.Faces.Count; i++)
          f_planes[i] = new Plane(m.MeshFaceCenter(i), m.FaceNormals[i]);
      }

      //Adjust to surface
      if(s != null){
        for(int i = 0; i < f_planes.Length; i++){
          double u, v;
          s.ClosestPoint(f_planes[i].Origin, out u, out v);
          Vector3d normal = s.NormalAt(u, v);
          Vector3d xaxis = Vector3d.CrossProduct(normal, f_planes[i].YAxis);
          Vector3d yaxis = Vector3d.CrossProduct(normal, xaxis);
          //f_planes[i] = new Plane(s.PointAt(u, v), xaxis, yaxis);
          f_planes[i] = new Plane(f_planes[i].Origin, xaxis, yaxis);
        }
      }

    }

    public void get_face_edge_planes()
    {

      fe_planes = new Plane[f][];


      for (int i = 0; i < f; i++)
      {
        int n = f_v[i].Length;
        fe_planes[i] = new Plane[n];

        for (int j = 0; j < f_v[i].Length; j++)
        {
          int v1 = f_v[i][(j + 0) % n];
          int v2 = f_v[i][(j + 1) % n];

          int e = this.m.TopologyEdges.GetEdgeIndex(v1, v2);
          int[] cf = this.m.TopologyEdges.GetConnectedFaces(e);



          Vector3d sum = Vector3d.Zero;
          for (int k = 0; k < cf.Length; k++)
            sum += this.m.FaceNormals[cf[k]];
          sum /= cf.Length;

          Plane edgePlane = new Plane((Point3d) (this.m.Vertices[v1] + this.m.Vertices[v2]) * 0.5, this.m.Vertices[v1] - this.m.Vertices[v2], sum);
          fe_planes[i][j] = edgePlane;

          //Adjust to surface
          if(s != null){

            double u, v;
            s.ClosestPoint(fe_planes[i][j].Origin, out u, out v);
            Vector3d normal = s.NormalAt(u, v);
            //Vector3d xaxis = Vector3d.CrossProduct(normal, e_planes[i][j].YAxis);
            //Vector3d yaxis = Vector3d.CrossProduct(normal, xaxis);
            //s.PointAt(u, v)
            fe_planes[i][j] = new Plane(fe_planes[i][j].Origin, Vector3d.CrossProduct(normal, fe_planes[i][j].ZAxis), normal);

          }

          foreach(Brep brep in this.projection_breps){
            if(brep.IsPointInside(fe_planes[i][j].Origin, 0.01, false)){
              Transform xform = Rhino.Geometry.Transform.PlanarProjection(Plane.WorldXY);
              fe_planes[i][j].Transform(xform);
            }
          }


        }//for j
      }//for i
    }

    public void get_bisector_planes()
    {
      bi_planes = new Plane[f][];

      for (int i = 0; i < f; i++)
      {
        int n = f_v[i].Length;
        bi_planes[i] = new Plane[n];
        for (int j = 0; j < n; j++)
        {
          var pl1 = fe_planes[i][j];
          var pl0 = fe_planes[i][MathUtil.Wrap(j + 1, n)];
          bi_planes[i][j] = PlaneUtil.DihedralPlane(pl0, pl1);
        }
      }//for i
    }

    public void get_edges(){


      if(this.has_ngons) {
        e_ngon_e = this.m._EAll();
        this.e = e_ngon_e.Count;
      }else{

        e_ngon_e = new Dictionary< int,int>();
        for(int i = 0; i < this.m.TopologyEdges.Count; i++ ){
          e_ngon_e.Add(i, i);
        }

      }
      this.e = e_ngon_e.Count;

    }

    public void get_edge_faces(){

      if(this.has_ngons){
        this.e_f = this.m._EF();

      }else{
        this.e_f = new int[this.m.TopologyEdges.Count][];
        for(int i = 0; i < this.m.TopologyEdges.Count;i++)
          this.e_f[i] = this.m.TopologyEdges.GetConnectedFaces(i);
      }
    }


    List<int> found_ids = new List<int>();
    public void get_edge_vectors(List<Line> lines){

      //Init empty vectors
      this.insertion_vectors = new Vector3d[this.e];


      //Get edge lines including naked
      this.e_lines = new Line[this.e];
      foreach(var pair in this.e_ngon_e){
        this.e_lines[pair.Value] = this.m.TopologyEdges.EdgeLine(pair.Key);
        //RhinoDoc.ActiveDoc.Objects.AddLine(this.e_lines[pair.Value]);
        //RhinoApp.WriteLine(string.Format("{0} {1}",pair.Key,pair.Value));
      }



      //Create rtree and add lines
      RTree rTree = new RTree();
      for (int i = 0; i < this.e_lines.Length; i++)
        rTree.Insert(this.e_lines[i].BoundingBox, i);

      //Search tree
      for(int i = 0; i < lines.Count;i++ ){
        BoundingBox bbox = lines[i].BoundingBox;
        bbox.Inflate(Rhino.RhinoDoc.ActiveDoc.ModelAbsoluteTolerance);
        bbox.Inflate(1);
        rTree.Search(lines[i].BoundingBox, BoundingBoxCallback);

        //iterate through found ids and check if end point lies on a mesh edge
        foreach(var  id in found_ids ){
          //RhinoDoc.ActiveDoc.Objects.AddLine(lines[i]);
          //RhinoDoc.ActiveDoc.Objects.AddLine(e_lines[id]);
          //break;
          if( this.e_lines[id].ClosestPoint(lines[i].From, true).DistanceToSquared(lines[i].From) < Rhino.RhinoDoc.ActiveDoc.ModelAbsoluteTolerance){
            this.insertion_vectors[id] = lines[i].Direction.UnitVector();
            //RhinoApp.WriteLine("Hi");
          }else if( this.e_lines[id].ClosestPoint(lines[i].To, true).DistanceToSquared(lines[i].To) < Rhino.RhinoDoc.ActiveDoc.ModelAbsoluteTolerance){
            this.insertion_vectors[id] = lines[i].Direction.UnitVector();
            // RhinoApp.WriteLine("Hi");
          }
        }
        //break;
        // RhinoApp.WriteLine(found_ids.Count.ToString());
        found_ids = new List<int>();

      }

    }

    void BoundingBoxCallback(object sender, RTreeEventArgs e)
    {
      //var boxSearchData = e.ToString();
      // RhinoApp.WriteLine(string.Format("{0} {1}",e.Id,e.IdB));
      found_ids.Add(e.Id);
    }

    //todo
    public void get_edge_planes(){

      e90_planes = new Plane[e_ngon_e.Count];
      e90_multiple_planes = new Plane[e_ngon_e.Count][];
      for (int i = 0; i < e_ngon_e.Count; i++)
      {




        int id = e_ngon_e.ElementAt(i).Key;

        if(this.m.TopologyEdges.GetConnectedFaces(id).Length == 1){
          e90_planes[i] = Plane.Unset;
          e90_multiple_planes[i] = new Plane[]{Plane.Unset};
          continue;
        }

        Line edge_line = this.m.TopologyEdges.EdgeLine(id);
        Point3d origin = edge_line.Mid();
        Vector3d zaxis = edge_line.Direction.UnitVector();
        IndexPair pair = this.m.TopologyEdges.GetTopologyVertices(id);
        //edge vertex normals
        Vector3d yaxis = ((Vector3d) (this.m.Normals[pair.I] + this.m.Normals[pair.J])) * 0.5;
        //or face normals
        yaxis = (this.f_planes[this.e_f[i][0]].ZAxis + this.f_planes[this.e_f[i][1]].ZAxis) * 0.5;

        //this.f_planes[]

        if(this.s != null){
          double u, v;
          this.s.ClosestPoint(origin, out u, out v);
          yaxis = this.s.NormalAt(u, v);
        }

        Vector3d xaxis = Vector3d.CrossProduct(zaxis, yaxis);

        //orient x-axis towards first edge index
        if((origin + xaxis).DistanceToSquared(this.f_planes[this.e_f[i][0]].Origin) <
          (origin - xaxis).DistanceToSquared(this.f_planes[this.e_f[i][0]].Origin))
          xaxis *= -1;

        //Incase insertion vectors are given
        if( !(insertion_vectors[i].X == 0 && insertion_vectors[i].Y == 0 && insertion_vectors[i].Z == 0)  ){


          //Project given vector to a plane
          Plane edge_plane = new Plane(this.e_lines[i].Mid(), yaxis);
          Transform xform = Transform.PlanarProjection(edge_plane);
          Vector3d xaxis_ = insertion_vectors[i];
          xaxis_.Transform(xform);

          if((Point3d.Origin + xaxis_).DistanceToSquared(Point3d.Origin + xaxis) >
            (Point3d.Origin - xaxis_).DistanceToSquared(Point3d.Origin + xaxis))
            xaxis_ *= -1;
          xaxis = xaxis_;


          //orient x-axis towards first edge index


        }



        //set plane
        e90_planes[i] = new Plane(origin, xaxis, yaxis);



        //1) By N 2) by division length 3) in both cases consider lists
        //Skip emppty

        int divisions = 1;


        if(this.edge_division_len.Count > 0){

          if(this.edge_division_len.Count == this.e){
            divisions = (int) rhino_util.MathUtil.Constrain((int) Math.Ceiling(edge_line.Length / this.edge_division_len[i]), 1, 10);
          }else{
            divisions = (int) rhino_util.MathUtil.Constrain((int) Math.Ceiling(edge_line.Length / this.edge_division_len[0]), 1, 10);
          }




        }else if(this.edge_divisions.Count > 0){

          if(this.edge_divisions.Count == this.e){
            divisions = this.edge_divisions[0];
          }else{
            divisions = this.edge_divisions[i];
          }


        }





        Point3d[] pts = edge_line.InterpolateLine(divisions, false);
        e90_multiple_planes[i] = new Plane[pts.Length];

        for(int j = 0; j < pts.Length; j++){
          e90_multiple_planes[i][j] = PlaneUtil.ChangeOrigin(e90_planes[i], pts[j]);
        }





      }







    }


    public void get_connectors(){


      this.e_polylines = new Polyline[e90_multiple_planes.Length][];
      this.e_polylines_planes = new Plane[e90_multiple_planes.Length][];
      this.e_polylines_index = new string[e90_multiple_planes.Length][];



      for(int i = 0; i < e90_multiple_planes.Length; i++ ){

        this.e_polylines[i] = new Polyline[e90_multiple_planes[i].Length * 2];
        this.e_polylines_planes[i] = new Plane[e90_multiple_planes[i].Length];
        this.e_polylines_index[i] = new string[e90_multiple_planes[i].Length];


        for(int j = 0; j < e90_multiple_planes[i].Length;j++){
          if(e90_multiple_planes[i][j] == Plane.Unset){
            this.e_polylines[i] = new Polyline[0];
          }else{

            if(this.rect_height > 0 && this.rect_width > 0){

              //type0


              Rectangle3d rect0 = new Rectangle3d(
                e90_multiple_planes[i][j].MovePlanebyAxis(this.rect_thickness * 0.5),
                new Interval(-rect_width * 0.5, rect_width * 0.5),
                new Interval(-rect_height * 0.5, rect_height * 0.5));
              Rectangle3d rect1 = new Rectangle3d(
                e90_multiple_planes[i][j].MovePlanebyAxis(this.rect_thickness * -0.5),
                new Interval(-rect_width * 0.5, rect_width * 0.5),
                new Interval(-rect_height * 0.5, rect_height * 0.5));
              this.e_polylines[i][j * 2 + 0] = rect0.ToPolyline();
              this.e_polylines[i][j * 2 + 1] = rect1.ToPolyline();
            }else if(this.rect_height <= 0 && this.rect_width <= 0){

              double w = Math.Abs(this.rect_height);
              double h = Math.Abs(this.rect_width);

              //type1
              Plane e_plane = new Plane(e90_multiple_planes[i][j]);
              e_plane.Rotate(Math.PI * 0.5, e_plane.YAxis);
              Plane top_plane_0 = this.f_planes[this.e_f[i][0]].MovePlanebyAxis(this.face_positions.Last()).MovePlanebyAxis(this.face_thickness * 0.5 + h);
              Plane top_plane_1 = this.f_planes[this.e_f[i][1]].MovePlanebyAxis(this.face_positions.Last()).MovePlanebyAxis(this.face_thickness * 0.5 + h);
              Plane bot_plane_0 = this.f_planes[this.e_f[i][0]].MovePlanebyAxis(this.face_positions.First()).MovePlanebyAxis(this.face_thickness * -0.5 - h);
              Plane bot_plane_1 = this.f_planes[this.e_f[i][1]].MovePlanebyAxis(this.face_positions.First()).MovePlanebyAxis(this.face_thickness * -0.5 - h);


              Plane e_plane_ = new Plane(this.e90_planes[i]);
              e_plane_.Rotate(Math.PI * 0.5, e_plane_.YAxis);


              //            if((e_plane_.Origin + e_plane_.ZAxis).DistanceToSquared(this.f_planes[this.e_f[i][0]].Origin) >
              //              (e_plane_.Origin - e_plane_.ZAxis).DistanceToSquared(this.f_planes[this.e_f[i][0]].Origin))
              //              e_plane.Flip();

              Plane[] side_planes = new Plane[]{

                top_plane_0,
                e_plane,
                top_plane_1,
                e_plane.MovePlanebyAxis(w * 0.5),
                bot_plane_1,
                e_plane,
                bot_plane_0,
                e_plane.MovePlanebyAxis(w * -0.5),

                };

              Polyline type1_0 = rhino_util.PolylineUtil.PolylineFromPlanes(e90_multiple_planes[i][j].MovePlanebyAxis(-this.rect_thickness * 0.5), side_planes.ToList());
              Polyline type1_1 = type1_0.Translate(e90_multiple_planes[i][j].ZAxis * this.rect_thickness);
              this.e_polylines[i][j * 2 + 0] = type1_0;
              this.e_polylines[i][j * 2 + 1] = type1_1;
              this.e_polylines_planes[i][j] = e90_multiple_planes[i][j].MovePlanebyAxis(this.rect_thickness * 0.5);
              this.e_polylines_index[i][j] = string.Format("{0}-{1}_{2}", this.e_f[i][0], this.e_f[i][1], j);

            }
          }
        }
      }

    }

    //Compute geometry
    public void get_face_polylines(){




      bool zero_layer = this.face_positions.Count == 0;

      this.f_polylines_index = new string[f][];
      this.f_polylines_planes = new Plane[f][];
      this.f_polylines = new Polyline[f][];

      for(int i = 0; i < f; i++){

        if(this.face_positions.Count == 0){

          f_polylines[i] = new Polyline[2];

          f_polylines[i][0] = PolylineUtil.OutlineFromFaceEdgeCorner(f_planes[i].MovePlanebyAxis(this.face_thickness * -0.5), fe_planes[i], bi_planes[i], 2);
          f_polylines[i][1] = PolylineUtil.OutlineFromFaceEdgeCorner(f_planes[i].MovePlanebyAxis(this.face_thickness * 0.5), fe_planes[i], bi_planes[i], 2);

          f_polylines_planes[i] = new Plane[1]{
            f_planes[i].MovePlanebyAxis(this.face_thickness * 0.5)
            };

          f_polylines_index[i] = new string[1]{
            i.ToString()
            };


        }else{

          f_polylines[i] = new Polyline[this.face_positions.Count * 2];
          f_polylines_planes[i] = new Plane[this.face_positions.Count];
          f_polylines_index[i] = new string[this.face_positions.Count];

          for(int j = 0; j < this.face_positions.Count ; j++){
            Polyline pline0 = PolylineUtil.OutlineFromFaceEdgeCorner(f_planes[i].MovePlanebyAxis(this.face_positions[j] + this.face_thickness * -0.5), fe_planes[i], bi_planes[i], 2);
            Polyline pline1 = PolylineUtil.OutlineFromFaceEdgeCorner(f_planes[i].MovePlanebyAxis(this.face_positions[j] + this.face_thickness * 0.5), fe_planes[i], bi_planes[i], 2);
            //f_polylines[i][j] = rhino_util.PolylineUtil.PolylineFromPlanes(f_planes[i].MovePlanebyAxis(this.face_thickness[j]), e_planes[i].ToList());
            f_polylines[i][j * 2 + 0] = pline0;
            f_polylines[i][j * 2 + 1] = pline1;
            f_polylines_planes[i][j] = f_planes[i].MovePlanebyAxis(this.face_positions[j] + this.face_thickness * 0.5);

            f_polylines_index[i][j] = this.face_positions.Count == 1 ? i.ToString() : string.Format("{0}-{1}", i, j);
          }

        }




      }

    }






  }
# ---------- end c_script ----------
tag = TextTag()  # disabled
tag_2 = TextTag3D(Size=25, Justification=2)  # disabled
crv_2 = Curve()  # disabled
crv_3 = Curve()  # disabled
crv_4 = Curve(flatten([crv_2, crv_3]))  # disabled
panel_2 = Panel(c_script.e_id)  # disabled
partition = PartitionList(List=crv_4, Size=2)  # disabled
input_set = Input_set(Plines=partition)  # disabled
loft = Loft(Polylines1=partition)  # disabled
number_slider_6 = Slider(1, range=0..1)  # disabled
solver = Solver(Data=input_set, Find=number_slider_6, Get=4)  # disabled
input_get = Input_get(Data=solver)  # -> Plines, Insertion_vectors, Joints_per_face, Three_valence, Adjacency; disabled
loft_2 = Loft(Polylines1=input_get.Plines)  # disabled

mesh_2 = Mesh(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)
crv_5 = Curve([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])
brep_2 = Brep([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])
connectors = Connectors(
    Mesh=mesh_2,
    Face_positions=Slider(0, range=-10..10),
    Face_thickness=Slider(4, range=0..10),
    Divisions=Slider(2, range=1..10),
    Division_len=Slider(15, range=1..100),
    Edge_vectors=crv_5,
    Rect_width=Slider(-2, range=-20..20),
    Rect_height=Slider(-9, range=-20..20),
    Rect_thickness=Slider(1, range=1..2),
    Projection=brep_2)  # -> F, F_pl, F_id, E, E_pl, E_id
tag_3 = TextTag3D(
    Location=[connectors.E_pl, connectors.F_pl],
    Text=[connectors.E_id, connectors.F_id],
    Size=4,
    Colour=RGB(255, 0, 77),
    Justification=2)
crv_6 = Curve(flatten(connectors.E))
crv_7 = Curve(flatten(connectors.F))
crv_8 = Curve(flatten([crv_7, crv_6]))
partition_2 = PartitionList(List=crv_8, Size=2)
input_set_2 = Input_set(Plines=partition_2)
loft_3 = Loft(Polylines1=partition_2)
solver_2 = Solver(Data=input_set_2, Find=Slider(1, range=0..1), Get=Slider(4, range=0..4))
input_get_2 = Input_get(Data=solver_2)  # -> Plines, Insertion_vectors, Joints_per_face, Three_valence, Adjacency
crv_9 = Curve(input_get_2.Plines)
loft_4 = Loft(Polylines1=input_get_2.Plines)
previewedges = PreviewEdges(Mesh=mesh_2, Tolerance=0.44)
gl_shader = GLShader(
    Vertex=[Point(-1, -1, -1), Point(1, -1, -1), Point(1, 1, -1), Point(-1, 1, -1)],
    Color=RGB(0, 0, 0),
    Thickness=5,
    Res=15,
    DepthTestingEnabled=False,
    DepthWritingEnabled=False,
    DrawMode=6,
    FragmentShader="""#version 330 core
uniform sampler2D _depthBuffer;
uniform sampler2D _colorBuffer;

uniform vec2 _viewportSize;
uniform vec4 color;
uniform float thickness;
uniform float res;

void main() 
{
  vec2 uv = gl_FragCoord.xy / _viewportSize;

  vec4 buffer = texture(_depthBuffer, uv);
  float val = step(0.9999, buffer.x);
  float col = 1.0;
  float div = res;
  float stepang = 360.0 / div;
  for(float i = 0; i<div; i++){
    vec4 bufferP = texture(_depthBuffer, (gl_FragCoord.xy + vec2(cos(radians(stepang*i)), sin(radians(stepang*i)))*thickness) / _viewportSize);
    float valP = step(0.9999, bufferP.x);
    if(val - valP > 0.0){
      col *= 0.0;
    }
  }
  
  vec3 col3 = mix(color.xyz, texture(_colorBuffer, uv).xyz, col);
  
  gl_FragColor = vec4(vec3(col3), 1.0);
 
}""",
    GLShader=(0, 1, 0),
    PreviewSortOrder=5,
    VertexShader="""#version 330

layout(location = 0) in vec3 vertex;



out vec3 normal;

void main() {
  gl_Position = vec4(vertex,1.0);
}""",
    glLineWidth=1,
    glPointSize=8)
preview = CustomPreview(Geometry=mesh_2, Material=ColourSwatch(SwatchColor=RGB(168, 168, 168)))
display = CurvePreview(Curve=previewedges)
